# Grasshopper definition Hopsurltest (1).gh (Grasshopper 1.0.8)

second_number = GetNumber(Slider(3, range=0..10), AtLeast=1, AtMost=1, Maximum=1.797693135e+308, Minimum=-1.797693135e+308, TreeAccess=False)
first_bumber = GetNumber(Slider(5, range=0..10), AtLeast=1, AtMost=1, Maximum=1.797693135e+308, Minimum=-1.797693135e+308, TreeAccess=False)
addition = Addition(A=first_bumber, B=second_number)
context_print = ContextPrint(Text=addition)
