# Grasshopper definition Hopsurltest.gh (Grasshopper 1.0.8)
# plug-ins: Hops

second_number = GetNumber(AtLeast=1, AtMost=1, Maximum=1.797693135e+308, Minimum=-1.797693135e+308, TreeAccess=False)
# https://drive.google.com/file/d/1JMb-vIS76j6rgbzPSlCa79hGvxgUkU07/view?usp=sharing
first_bumber = GetNumber(AtLeast=1, AtMost=1, Maximum=1.797693135e+308, Minimum=-1.797693135e+308, TreeAccess=False)
addition = Addition(A=first_bumber, B=second_number)
context_print = ContextPrint(Text=addition)
hops = Hops(
    CacheResultsInMemory=True,
    CacheSolveResults=True,
    RemoteSolveVersion=(0, 1, 0),
    ShowInput_Enabled=False,
    ShowInput_Path=False,
    SynchronousSolve=True)
